# Grasshopper definition voxelate.gh (Grasshopper 1.0.7)

ghpython_script = GhPythonScript()  # -> out, brep, a, b, c
# ---------- ghpython_script: Python ----------
import math
import random
import Rhino.Geometry as rg
import Rhino.RhinoDoc as rc
import rhinoscriptsyntax as rs
import ghpythonlib.components as gh

import os
import Rhino



path = os.path.dirname(os.path.abspath(Rhino.RhinoDoc.ActiveDoc.Path))
brep = gh.Import3DM(os.path.join(path, "voxelate", "brep.3dm"), "*", "*")

class VoxelBrep:
    def __init__(self, brep, voxel_size, voxel_angle):
        self.brep = brep
        self.voxel_size = voxel_size
        self.voxel_angle = voxel_angle
        
        self.__voxelate()
        
    def __voxelate(self):
        """main func"""
        self.__gen_moved_brep()
        self.__gen_plane()
        self.__gen_moved_brep_bbox()
        self.__gen_grid()
        self.__gen_voxels()
        
    def __gen_moved_brep(self):
        self.moved_brep, _ = gh.Move(geometry=self.brep, motion=rg.Point3d(100, 0, 0))
        self.moved_brep_mesh = rg.Mesh.CreateFromBrep(self.moved_brep, rg.MeshingParameters(0))
        
    def __gen_plane(self):
        self.plane = gh.RotatePlane(plane=rg.Plane.WorldXY, angle=self.voxel_angle)
        
    def __gen_moved_brep_bbox(self):
        self.moved_brep_bbox, _ = gh.BoundingBox(content=self.moved_brep, plane=self.plane)
        self.moved_brep_bbox_faces, _, _ = gh.DeconstructBrep(brep=self.moved_brep_bbox)
        self.moved_brep_bbox_bottom_face = sorted(self.moved_brep_bbox_faces, key=lambda f: gh.Area(geometry=f).centroid.Z)[0]
        
    def __gen_grid(self):
        moved_brep_bbox_bottom_face_segments, _ = gh.Explode(curve=self.moved_brep_bbox_bottom_face, recursive=True)
        
        seg_1, seg_2, _, _ = moved_brep_bbox_bottom_face_segments
        seg_1_vector = seg_1.Line.PointAtLength(self.voxel_size) - seg_1.Line.PointAt(0)
        seg_2_vector = seg_2.Line.PointAtLength(self.voxel_size) - seg_2.Line.PointAt(0)
        
        grid_origin = gh.HorizontalFrame(curve=seg_1, parameter=0)
        base_rectangle, _ = gh.Rectangle(plane=grid_origin, x_size=self.voxel_size, y_size=self.voxel_size, radius=0)
        
        x_grid = []
        for x in range(int(seg_1.Line.Length // self.voxel_size) + 1):
            motion = seg_1_vector * x
            moved_rectangle, _ = gh.Move(geometry=base_rectangle, motion=motion)
            x_grid.append(moved_rectangle)
        
        base_grid = []
        for y in range(int(seg_2.Line.Length // self.voxel_size) + 1):
            motion = seg_2_vector * y
            moved_rectangles, _ = gh.Move(geometry=x_grid, motion=motion)
            base_grid.extend(moved_rectangles)
        
        self.grid = []
        for z in range(int(self.moved_brep_bbox.Z[1] // self.voxel_size) + 1):
            motion = rg.Point3d(0, 0, z * self.voxel_size)
            moved_rectangles, _ = gh.Move(geometry=base_grid, motion=motion)
            self.grid.extend(moved_rectangles)
            
    def __gen_voxels(self):
        self.grid_centroid = [g.Center for g in self.grid]
        self.inside_grid = gh.CullPattern(
            list=self.grid, 
            cull_pattern=gh.MeshInclusion(
                mesh=gh.MeshJoin(self.moved_brep_mesh), 
                point=self.grid_centroid, 
                strict=False
            )
        )
        self.inside_grid_centroid = [g.Center for g in self.inside_grid]
        
#        self.voxels_plane = gh.ConstructPlane(
#            origin=self.inside_grid_centroid,
#            x_axis=self.plane.XAxis,
#            y_axis=self.plane.YAxis
#        )
#        
#        x_interval = rg.Interval(-self.voxel_size / 2, self.voxel_size / 2)


if __name__ == "__main__":
    voxel_brep = VoxelBrep(brep=brep, voxel_size=3, voxel_angle=0.2)
    a = voxel_brep.inside_grid_centroid
    b = voxel_brep.plane
# ---------- end ghpython_script ----------
deconstruct_plane = DeconstructPlane(Plane=ghpython_script.b)  # -> Origin, XAxis, YAxis, ZAxis
geometry = Geometry(ghpython_script.a)
construct_plane = ConstructPlane(Origin=geometry, XAxis=deconstruct_plane.XAxis, YAxis=deconstruct_plane.YAxis)
domain_box = DomainBox(Base=construct_plane, X=" -1.5 To 1.5", Y=" -1.5 To 1.5", Z="3")
